# Grasshopper definition window_in_wall.ghx (Grasshopper 1.0.7)

reload = Button()
py = PythonScript(reload=reload)
# ---------- py: Python ----------
from compas_rhino.utilities.misc import get_tolerance
from compas_rhino.utilities.misc import unload_modules

from compas_ghpython import unload_modules

unload_modules("compas")
unload_modules("compas_fab")
unload_modules("ur_fabrication_control")
unload_modules("assembly_information_model")
unload_modules("am_information_model")
unload_modules("window_in_wall")
# ---------- end py ----------
py_2 = PythonScript()  # -> HERE, DATA
# ---------- py_2: Python ----------
import os

HERE = os.path.dirname(ghdoc.Path)
DATA = os.path.abspath(os.path.join(HERE, "..", "data"))

#print(HERE)
#print(DATA)
# ---------- end py_2 ----------

height = Number(3.2)
elsize = Number(0.1)
width = Number(3.5)
create_wall = GhPythonScript(init=Button(), width=width, height=height, elsize=elsize)  # -> out, wall
# ---------- create_wall: Python ----------
from window_in_wall import Wall


# create wall
wall = Wall()


# construct COMPAS quad mesh from width and height
wall.create_quad_mesh_from_dimensions(width, height, elsize)
# ---------- end create_wall ----------

list = ValueList({"circular", "persian"}, selected="persian")
make_gate = GhPythonScript(wall=create_wall.wall, make_gate=Toggle(True), gate_type=list)  # -> out, wall
# ---------- make_gate: Python ----------
if make_gate:
    if gate_type == "circular":
        wall.gate_circular()
    
    if gate_type == "persian":
        wall.gate_persian()
# ---------- end make_gate ----------

displacement = GhPythonScript(wall=make_gate.wall, comp_displ=Toggle(True))  # -> out, wall
# ---------- displacement: Python ----------
from compas.rpc import Proxy


if comp_displ:
    wall_methods_numpy = Proxy('window_in_wall.wall_methods_numpy')
    #wall_methods_numpy.stop_server()
    #wall_methods_numpy.start_server()
    
    # compute displacement
    solX, solZ = wall_methods_numpy.compute_displacement(wall.mesh, wall.gate_points, wall.x_size, wall.z_size)
    print (solX[:100])
    # update vertex attributes with displacement values
    for v, data in wall.mesh.vertices(data=True):        
        wall.mesh.vertex_attribute(v, "x_disp", value=solX[v]) #value=solX[n_from_ij(i,j, wall.z_size)]
        wall.mesh.vertex_attribute(v, "z_disp", value=solZ[v]) #value=solZ[n_from_ij(i,j, wall.z_size)]

        # preview with displaced vertex coordinates
        wall.mesh.vertex_attribute(v, "x", value=data["x"]-solX[v]) #value=solX[n_from_ij(i,j, wall.z_size)]
        wall.mesh.vertex_attribute(v, "z", value=data["z"]-solZ[v]) #value=solZ[n_from_ij(i,j, wall.z_size)]
# ---------- end displacement ----------

wave = GhPythonScript(
    wall=displacement.wall,
    wave=Toggle(False),
    amp=Slider(0.07, range=0..0.1),
    freq=Slider(2, range=1..3),
    phase=Slider(0, range=0..3))  # -> out, wall; inputs wave: Boolean
# ---------- wave: Python ----------
if wave:
    wall.undulate(amp, freq, phase)
# ---------- end wave ----------

np_test = GhPythonScript(wall=wave.wall, run_test_func=Toggle(False))  # -> out, wall
# ---------- np_test: Python ----------
if run_test_func:
    x= wall.numpy_test_function(1)
    print(x)
# ---------- end np_test ----------

visualize = GhPythonScript(wall=wave.wall)  # -> out, rhmesh, vertices
# ---------- visualize: Python ----------
from compas_ghpython.artists import MeshArtist

# Mesh Artist for visualization
artist = MeshArtist(wall.mesh)
#vertices = artist.draw_vertices()
#edges = artist.draw_edges()
#faces = artist.draw_faces()
#labels = {key: key for key in mesh.vertices()}

rhmesh = artist.draw()


# draw gate points
v = []
for vertex in wall.mesh.vertices():
    gp = wall.mesh.vertex_attribute(vertex, name='gate_point_value')
    if gp: v.append(vertex)
    
vertices = artist.draw_vertices(vertices=v)
# ---------- end visualize ----------
pt = Point(visualize.vertices)
mesh = Mesh(visualize.rhmesh)
preview = CustomPreview(Geometry=mesh, Material=ColourSwatch(SwatchColor=RGB(255, 125, 125)))
preview_2 = CustomPreview(Geometry=pt, Material=ColourSwatch(SwatchColor=RGB(255, 184, 184)))
